% Simulink data dictionary HevMmReferenceApplication.sldd
% references VehicleConfig.sldd
% references HevMmReferenceApplicationParam.sldd

BMS_Info = Simulink.Bus()
  Faults_Bus: Bus: Faults
  BMS_State: Enum: BMS_State_Enum
  SOC: Bus: SOC_Est

BMS_Cmd = Simulink.Bus()
  CurrentLimits_Bus: Bus: CurrentLimits
  ChargeCurrentReq: single, Unit="A"
  ContactorsCmd_Bus: Bus: Contactors_Cmd
  BalCmd: boolean[1 96]

Min_Max_Cells = Simulink.Bus(DataScope="Exported")
  MinCellVolt: single, Min=0, Max=5, Unit="V"
  MaxCellVolt: single, Min=0, Max=5, Unit="V"
  MinCellTemp: single, Min=263.15, Max=333.15, Unit="K"
  MaxCellTemp: single, Min=263.15, Max=333.15, Unit="K"

Faults = Simulink.Bus()
  VoltSensor: boolean
  OverCurrent: boolean
  HighTemp: boolean
  LowTemp: boolean
  OverVolt: boolean
  UnderVolt: boolean
  Charger: boolean
  Inverter: boolean

Contactors_Cmd = Simulink.Bus()
  PosContactorChgrCmd: boolean
  PreChargeRelayChgrCmd: boolean
  NegContactorChgrCmd: boolean
  PosContactorInvtrCmd: boolean
  PreChargeRelayInvtrCmd: boolean
  NegContactorInvtrCmd: boolean

CurrentLimits = Simulink.Bus(DataScope="Exported")
  DischargeCurrentLimit: single, Unit="A"
  ChargeCurrentLimit: single, Unit="A"

SOC_Est = Simulink.Bus()
  SOC_CC: single
  SOC_UKF: single
  SOC_EKF: single

Sensors = Simulink.Bus()
  Cell_Voltages: single[96], Min=0, Max=5, Unit="V"
  Pack_Voltage: single, Min=0, Max=480, Unit="V"
  Pack_Current: single, Min=-100, Max=100, Unit="A"
  Cell_Temperatures: single[96], Min=-10, Max=40, Unit="degC"
  Vout_Chgr: single, Min=-500, Max=500, Unit="V"
  Vout_Invtr: single, Min=-500, Max=500, Unit="V"

tauerr = 0.08